# Grasshopper definition emocPHexOne.gh (Grasshopper 1.0.7)

ladybug = Ladybug_Ladybug()  # -> out; plug-in component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
honeybee = Honeybee_Honeybee()  # -> out; plug-in component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
idf2phpp = BT_CORE()  # -> out; plug-in component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

insulation_cost_per_square_meter = Panel("""11.3
11.8
6.5
12.50""")
insulation_thickness_meters = Panel(""".2413
.209
.089
.304""")
# GR1
insulation_λ_conductivity = Panel(""".0495
.0475
.029
.032""")

new_phpp_frame = BT_CreatePHPPwindowFrame(name="WindowThree", frameWidths=".098", frameUvalues=".84", psiGlazings=".02", psiInstalls=".040")  # -> out, PHPPFrame; inputs frameWidths: list, frameUvalues: list, psiGlazings: list, psiInstalls: list; plug-in component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
new_phpp_glazing = BT_CreatePHPPwindowGlazing(name="WindowThree", uValue=".69", gValue=".61")  # -> out, PHPPGlazing; plug-in component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
windowcost_sqm = Panel("120")

# ----
# GR2
panel = Panel("WindowOne")
new_phpp_frame_2 = BT_CreatePHPPwindowFrame(name=panel, frameWidths=".125", frameUvalues=".8", psiGlazings=".028", psiInstalls=".040")  # -> out, PHPPFrame; inputs frameWidths: list, frameUvalues: list, psiGlazings: list, psiInstalls: list; plug-in component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
new_phpp_glazing_2 = BT_CreatePHPPwindowGlazing(name=panel, uValue=".51", gValue=".42")  # -> out, PHPPGlazing; plug-in component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
windowcost_sqm_2 = Panel("140")

new_phpp_frame_3 = BT_CreatePHPPwindowFrame(name="WindowTwo", frameWidths=".111", frameUvalues=".55", psiGlazings=".02", psiInstalls=".040")  # -> out, PHPPFrame; inputs frameWidths: list, frameUvalues: list, psiGlazings: list, psiInstalls: list; plug-in component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
new_phpp_glazing_3 = BT_CreatePHPPwindowGlazing(name="WindowTwo", uValue=".58", gValue=".49")  # -> out, PHPPGlazing; plug-in component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
windowcost_sqm_3 = Panel("190")

# ----
# GR3
number_slider = Slider(1, range=1..3)

panel_2 = Panel("0.55")
ventilator = BT_CreateNewPHPPVentUnit(name="Cow's (My cat/assistant) ERV", HR_Eff="0.80", Elec_Eff=".36")  # -> out, ventUnit; plug-in component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
costerv = Panel("5200")

ventilator_2 = BT_CreateNewPHPPVentUnit(name="Martin's not as good ERV", HR_Eff="0.71", MR_Eff="0.2", Elec_Eff=".29")  # -> out, ventUnit; plug-in component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
costerv_2 = Panel("4800")

ventilator_3 = BT_CreateNewPHPPVentUnit(name="Ed's Really Good ERV", HR_Eff="0.85", MR_Eff="0.6", Elec_Eff=".45")  # -> out, ventUnit; plug-in component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
costerv_3 = Panel("5000")

# ----
# duct length input can be curve!
panel_3 = Panel("110")
vent_duct = BT_CreateNewPHPPVentDuct(ductLength=flatten(number_slider), insulThickness=panel_3)  # -> out, hrvDuct; inputs ductLength: list, ductWidth: list, insulThickness: list, insulConductivity: list; plug-in component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
vent_duct_2 = BT_CreateNewPHPPVentDuct(ductLength=flatten(number_slider), insulThickness="110")  # -> out, hrvDuct; inputs ductLength: list, ductWidth: list, insulThickness: list, insulConductivity: list; plug-in component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
